# Grasshopper definition CreateSheets_PlanGA1.0.gh (Grasshopper 1.0.7)
# plug-ins: CORE.Toolbox.Grasshopper, Rhino.Inside for Autodesk Revit

file_path = FilePath("P:\02 - Grasshopper\Sheet Creator\GAs.xlsx")
read_from_excel = ReadFromExcel(WorkbookFilepath=file_path, WorksheetName="Sheet1", Live=False, Stream=Toggle(True))
split_tree = SplitTree(Data=read_from_excel, Masks=flatten("{1}"))  # -> Positive, Negative
list_item = ListItem(List=split_tree.Negative, Index="0", Wrap=True)
list_item_2 = ListItem(List=split_tree.Negative, Index=Slider(2, range=0..2), Wrap=True)
sheet = Sheet(<sheet referenced from the Revit model>)
add_sheet = AddSheet(SheetNumber=list_item, SheetName=list_item_2, Template=sheet)
query_views = QueryViews(ViewName=list_item_2, IsDependent=False, IsTemplate=False)
query_view_types = QueryViewTypes(TypeName="Structural Plan")
type_filter = TypeFilter(Types=query_view_types, Inverted=False)
filter_elements = FilterElements(Elements=query_views, Filter=type_filter)
type = Type(<familysymbol referenced from the Revit model>, SelectedBuiltInCategory="autodesk.revit.category.family:titleBlocks")
add_title_block = AddTitleBlock(Sheet=add_sheet, Type=type)
cull_pattern = CullPattern(List=query_views, CullPattern=filter_elements)
add_viewport = AddViewport(Sheet=add_sheet, View=cull_pattern)
